# Grasshopper definition GenerateLightString.gh (Grasshopper 1.0.7)

brep = Brep(<brep referenced from the Rhino model>)
edges = BrepEdges(Brep=brep)  # -> Naked, Interior, NonManifold
planar = Planar(Curve=edges.Interior)  # -> Planar, Plane, Deviation
cull = CullPattern(List=edges.Interior, CullPattern=planar.Planar)
mesh = Mesh(brep)
edgescvx = ConvexEdges(Brep=brep)  # -> Convex, Concave, Mixed
edgeslin = EdgesFromLinearity(Brep=brep, Minimum=0, Maximum=1)  # -> Edges, Indices
filedge = FilletEdge(Shape=brep, Blend=0, Metric=0, Edges=edgescvx.Convex, Radii=Slider(0.1, range=0..0.1))
filedge_2 = FilletEdge(Blend=1, Metric=0)
